# Grasshopper definition process.gh (Grasshopper 1.0.7)
# Copyright: Arup

number_slider = Slider(0, range=0..10)

# ---- group: RH_IN:MyPoint
pt = Point(Point(38.3928714, 20.7666408, 0))

# ---- group: RH_IN:Radius
num = Number(Slider(5, range=0..10))

# ---- group: RH_IN:Radius_2
num_2 = Number()

# ---- group: RH_IN:MyCurve
crv = Curve(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)

# ---- group: RH_IN:MyMesh
mesh = Mesh(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)

# ---- group: RH_IN:MyBrep
brep = Brep(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)

# ---- group: RH_IN:Address
txt = Text("A75")

# ---- group: RH_IN:JobNumber
txt_2 = Text("A75")

# ---- group: RH_IN:ValueInt
int = Integer()

# ---- group: RH_IN:BoolWithToggle
bool = Boolean(Toggle(True))

# ---- group: RH_IN:BoolWithoutToggle
bool_2 = Boolean()

# ----
demesh = DeconstructMesh(Mesh=mesh)  # -> Vertices, Faces, Colours, Normals
sph = Sphere(Base=pt, Radius=num)
lng = ListLength(List=demesh.Vertices)
area = Area(Geometry=brep)  # -> Area, Centroid
len = Length(Curve=crv)
volume = Volume(Geometry=sph)  # -> Volume, Centroid

# ---- group: RH_OUT:Sphere
mesh_2 = Mesh(sph)

# ----
medges = MeshEdges(Mesh=mesh_2)  # -> NakedEdges, InteriorEdges, NonManifoldEdges
len_2 = Length(Curve=[medges.NakedEdges, medges.InteriorEdges, medges.NonManifoldEdges])  # -> flatten(Length)
sqr = Square(Value=int)
addition = Addition(A=bool, B=bool_2, C=num_2)
ma = MassAddition(Input=len_2)  # -> Result, PartialResults
format = Format(Format="Total length {0}", Culture=127, Data0=ma.Result)

# ---- group: RH_OUT:Volume
num_3 = Number(volume.Volume)

# ---- group: RH_OUT:NumVerts
num_4 = Number(lng)

# ---- group: RH_OUT:AreaForBrep
num_5 = Number(area.Area)

# ---- group: RH_OUT:MyLength
num_6 = Number(len)

# ---- group: RH_OUT:AddingBools
num_7 = Number(addition)

# ---- group: RH_OUT:SquareInt
num_8 = Number(sqr)

# ---- group: RH_OUT:BoolOuts
bool_3 = Boolean([bool_2, bool])

# ---- group: RH_OUT:Center
pt_2 = Point(volume.Centroid)

# ---- group: RH_OUT:Length_Report
txt_3 = Text([format, txt_2, txt])
