# Grasshopper definition process2.gh (Grasshopper 1.0.7)
# Copyright: Arup

# ---- group: RH_IN:MyPoint2
pt = Point(Point(-11.80180905, -2.025167646, 0))

# ---- group: RH_IN:Radius2
num = Number(Slider(5, range=0..10))

# ----
sph = Sphere(Base=pt, Radius=num)

# ---- group: RH_OUT:Sphere
mesh = Mesh(sph)

# ----
medges = MeshEdges(Mesh=mesh)  # -> NakedEdges, InteriorEdges, NonManifoldEdges

# ---- group: RH_OUT:SphereBrep
brep = Brep(sph)

# ---- group: RH_OUT:Edges
crv = Curve(flatten([medges.NakedEdges, medges.InteriorEdges, medges.NonManifoldEdges]))

# ----
demesh = DeconstructMesh(Mesh=mesh)  # -> Vertices, Faces, Colours, Normals
lng = ListLength(List=demesh.Vertices)
subtraction = Subtraction(A=lng, B=Slider(10, range=0..10))
reduce = RandomReduce(List=demesh.Vertices, Reduction=subtraction, Seed=1)

# ---- group: RH_OUT:MyPoint
pt_2 = Point(reduce)
